# Grasshopper definition Test_SGA.gh (Grasshopper 0.9.76)
# plug-ins: FrOG

number_slider = Slider(0.25, range=-10..10)
number_slider_2 = Slider(0.25, range=-10..10)
number_slider_3 = Slider(0.25, range=-10..10)
number_slider_4 = Slider(0.25, range=-10..10)
c_script = CSharpScript(a=number_slider, y=number_slider_2, z=number_slider_3, u=number_slider_4)  # -> out, A; inputs a: Double, y: Double, z: Double, u: Double
# ---------- c_script: C# ----------
    double [] x = new double[4];
    x[0] = a;
    x[1] = y;
    x[2] = z;
    x[3] = u;
    
    int d = x.Length;
    double x1 = x[0];
    double term1 = Math.Pow((x1 - 1), 2);

    double sum = 0;
    for (int i = 1; i < d; i++)
    {
      double xi = x[i];
      double xold = x[i - 1];
      double newval = (i + 1) * Math.Pow((2 * Math.Pow(xi, 2) - xold), 2);
      sum += newval;
    }

    A = (term1 + sum);
# ---------- end c_script ----------
framework_for_optimization_in_grasshoppe = FrOG01(Variables=[number_slider, number_slider_2, number_slider_3, number_slider_4], Objective=c_script.A)  # "Framework for Optimization in Grasshopper"
